# Grasshopper definition udp.gh (Grasshopper 0.9.76)
# plug-ins: gHowl

# ---- group: receive the message from Unity
ip_to_receive_on_this_computer = Panel("10.13.1.52")
port_to_receive_on = Panel("8051")
udp = UDPReceiver(Address=ip_to_receive_on_this_computer, Port=port_to_receive_on, Pattern=0)  # -> Info, Data
panel = Panel(udp.Info)

# ----
the_message_coming_from_unity = Panel(udp.Data)
c_script = CSharpScript(x=Slider(3, range=0..25), y=Slider(0, range=0..1), data=udp.Data)  # -> out, A; inputs x: Int32, y: Int32
# ---------- c_script: C# ----------
    string tmp = x.ToString() + ", " + y.ToString();
    A = "Messagge from Grasshopper: " + tmp;
# ---------- end c_script ----------
ip_to_send_to = Panel("10.13.1.52")
port_to_send_to = Panel("8050")
the_message_being_sent_to_unity = Panel(c_script.A)
udp_2 = UDPSender(Address=ip_to_send_to, Port=port_to_send_to, Pattern=0, Data=c_script.A)
panel_2 = Panel(udp_2)
